# Grasshopper definition 4450_HW04_npod.gh (Grasshopper 1.0.8)
# plug-ins: Karamba3D

node_x_position = Slider(0, range=0..15)
node_z_position = Slider(10, range=1..15)

number_of_legs = Slider(9, range=5..15)
radius = Slider(10, range=0..10)

# ---- group: npod generator
pt = Point(Point(0, 0, 0))
vec = VectorXYZ(XComponent=node_x_position, YComponent=0, ZComponent=node_z_position)  # -> Vector, Length
circle = CircleCNR(Center=pt, Normal=Vector(0, 0, 1), Radius=radius)

# ----
galapagos = Galapagos(fitness=ma, gene=[node_x_position, node_z_position])

# ---- group: npod generator / free node
move = Move(Geometry=pt, Motion=vec.Vector)  # -> Geometry, Transform

# ---- group: npod generator / evenly spaced points around a circle
divide = DivideCurve(Curve=circle, Count=number_of_legs, Kinks=False)  # -> Points, Tangents, Parameters

# ---- group: npod generator / create legs of truss
ln = Line(StartPoint=divide.Points, EndPoint=move.Geometry)

# ---- group: karamba analysis
vec_2 = VectorXYZ(XComponent="-2", YComponent=0, ZComponent="-5")  # -> Vector, Length
loads = LoadsKaramba3D(ForceVector=vec_2.Vector, Local=False, PosInd=move.Geometry, LCase="0", mode="Point")
linetobeam = LineToBeamKaramba3D(
    Line=ln,
    New=True,
    Remove=True,
    LimitDistance_m=0.005,
    Bending=Toggle(False),
    SetBucklingLength=True,
    ToPolylineMaxAngle=0.03,
    ToPolylineTolerance=0.01,
    ToPolylineMaxEdgeLength=0.25)  # -> Element, Points, Info
supp = SupportKaramba3D(PosInd=divide.Points, menu=[buttons(on, on, on, off, off, off)])
assemble = AssembleModelKaramba3D(Elem=linetobeam.Element, Support=supp, Load=loads, LimitDistance_m=0.005)  # -> Model, Info, Mass_kg, CenterOfGravity, LoadCaseNames
analyze = AnalyzeKaramba3D(Model=assemble.Model)  # -> CalculatedModel, MaximumDisplacement_cm, ResultingForceOfGravity_kN, ElasticEnergyChange_kNm
modelview = ModelViewKaramba3D(Model=analyze.CalculatedModel, ResultFactors=1, ResultCase=-1)  # -> Model, DeformedMesh, DeformedAxes, DeformedModel
beamview = BeamViewKaramba3D(Model=analyze.CalculatedModel)  # -> Model, MeshesOfRenderedBeams, DeformedBeamAxes, LegendColors, LegendTags

# ---- group: performance measure
b_forces = BeamForcesKaramba3D(AnalyzedModel=analyze.CalculatedModel, Ts="0")  # -> AnalyzedModel, flatten(NormalForce_kN), ShearForceVz_kN, ShearForceVy_kN, TorsionalMomentMt_kNm, BendingMomentMy_kNm, BendingMomentMz_kNm
abs = Absolute(Value=b_forces.NormalForce_kN)
len = Length(Curve=ln)
multiplication = Multiplication(A=abs, B=len)
ma = MassAddition(Input=multiplication)  # -> Result, PartialResults

# ----
# OBJECTIVE
num = Number(ma.Result)
